# Grasshopper definition main.gh (Grasshopper 1.0.8)

number_slider = Slider(3, range=0..10)
geometry = Geometry(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)
geometry_2 = Geometry(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)
python_3_script = Python3Script(script=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, building_brep=geometry, floor_height=Slider(3, range=0..10))  # -> out, walls, glasses, frames; inputs building_brep: Brep, floor_height: Double; unedited script template
python_3_script_2 = Python3Script()  # -> out, a; unedited script template
geometry_3 = Geometry(python_3_script.glasses)
panel = Panel(python_3_script.out)
